# Grasshopper definition Fichier-demo.gh (Grasshopper 1.0.7)

# ----
# Parameters to be shared
# (sliders, lists and toggles for now)
number_of_divisions = Slider(18, range=5..22)
range_step = Slider(9, range=5..17)
radius_size = ValueList({"Small Radius": 5, "Medium Radius": 13, "Big Radius": 20}, selected="Small Radius")
scale_factor = Slider(0.06, range=0..1)

panel = Panel("localhost")
panel_2 = Panel("ghxr")
panel_3 = Panel("""0
20
60
80
90
100""")
cir = Circle(Plane=PlaneXY(0, 0, 0), Radius=radius_size)
Z = UnitZ(Factor=panel_3)
move = Move(Geometry=cir, Motion=Z)  # -> Geometry, Transform
area = Area(Geometry=move.Geometry)  # -> Area, Centroid
panel_4 = Panel("""0.9
1.2
1.2
0.9
0.6
0.02""")
scale = Scale(Geometry=move.Geometry, Center=area.Centroid, Factor=panel_4)  # -> Geometry, Transform
loft = Loft(Curves=scale.Geometry, Options={Adjust=False, Closed=False, LoftEnds=0, LoftSimp=0, LoftType=0, Rebuild=10, Refit=0.01})
end = EndPoints(Curve=scale.Geometry)  # -> Start, End
nombre_de_segments = Slider(4, range=3..5)
intcrv = Interpolate(Vertices=end.Start, Degree=3, Periodic=False, KnotStyle=1)  # -> Curve, Length, Domain
thickness = Slider(1, range=0.5..1.5)
divide = DivideCurve(Curve=intcrv.Curve, Count=number_of_divisions, Kinks=False)  # -> Points, Tangents, Parameters
polygon = Polygon(Plane=divide.Points, Radius=thickness, Segments=nombre_de_segments, FilletRadius=0)  # -> Polygon, Length
series_step = Slider(0.1, range=0.05..0.2)
series = Series(Start=0, Step=series_step, Count=number_of_divisions)
panel_5 = Panel(series)
_0 = Integer(0)
_360 = Integer(360)
rotate = Rotate(Geometry=polygon.Polygon, Angle=series, Plane=PlaneXY(0, 0, 0))  # -> Geometry, Transform
dom = ConstructDomain(DomainStart=_0, DomainEnd=_360)
loft_2 = Loft(Curves=rotate.Geometry, Options={Adjust=False, Closed=False, LoftEnds=0, LoftSimp=0, LoftType=0, Rebuild=10, Refit=0.01})
panel_6 = Panel(dom)
range = Range(Domain=dom, Steps=range_step)
panel_7 = Panel(range)
rad = Radians(Degrees=range)
rotate_2 = Rotate(Geometry=loft_2, Angle=rad, Plane=PlaneXY(0, 0, 0))  # -> Geometry, Transform
mirror = Mirror(Geometry=rotate_2.Geometry, Plane=PlaneYZ(0, 0, 0))  # -> Geometry, Transform
résultat = Geometry([mirror.Geometry, rotate_2.Geometry, loft])
to_x_component = Slider(0, range=0..1)
from_x_component = Slider(0, range=0..1)
to_y_component = Slider(1, range=0..1)
to_z_component = Slider(0, range=0..1)
from_y_component = Slider(0, range=0..1)
from_z_component = Slider(1, range=0..1)
scale_2 = Scale(Geometry=résultat, Center=Point(0, 0, 0), Factor=scale_factor)  # -> Geometry, Transform
vec = VectorXYZ(XComponent=to_x_component, YComponent=to_y_component, ZComponent=to_z_component)  # -> Vector, Length
vec_2 = VectorXYZ(XComponent=from_x_component, YComponent=from_y_component, ZComponent=from_z_component)  # -> Vector, Length
join = BrepJoin(Breps=scale_2.Geometry)  # -> Breps, Closed
rotate_3 = Rotate(Center=Point(0, 0, 0), From=vec_2.Vector, To=vec.Vector)  # -> Geometry, Transform; disabled
join_2 = BrepJoin(Breps=join.Breps)  # -> Breps, Closed
mesh = MeshBrep(
    Brep=join_2.Breps,
    Settings={GridMaxCount=0, GridMinCount=16, JaggedSeams=False, MaxEdgeLength=0, MinEdgeLength=0.0001, MinTolerance=0, Refine=True, RefineAngle=0, RelativeTolerance=0.65, SimplePlanes=True, Tolerance=0})
mjoin = MeshJoin(Meshes=mesh)
item = ListItem(List=flatten(mjoin), Index=Slider(1, range=0..1), Wrap=True)
item_2 = ListItem(List=flatten(mjoin), Index=Slider(0, range=0..1), Wrap=True)

# ----
# Meshes to be shared
# (created from breps)
outsidemesh = Mesh(item)
insidemesh = Mesh(item_2)
