# Grasshopper definition axes-localisedmesh.gh (Grasshopper 1.0.7)
# plug-ins: GHXR

basescalefactor = Slider(5, range=0..10)
doublescaletoggle = BooleanToggle(False)
brep = Brep(<brep referenced from the Rhino model>)
panel = Panel("[{\"lat\":6360517.111927,\"lon\":661403.63,\"hdg\":0}]")
filter = StreamFilter(Gate=doublescaletoggle, Stream0=1, Stream1=2)
scale = Scale(Geometry=brep, Center=Point(0, 0, 0), Factor=basescalefactor)  # -> Geometry, Transform
scale_2 = Scale(Geometry=scale.Geometry, Center=Point(0, 0, 0), Factor=filter)  # -> Geometry, Transform
mesh = MeshBrep(
    Brep=scale_2.Geometry,
    Settings={GridMaxCount=0, GridMinCount=16, JaggedSeams=False, MaxEdgeLength=0, MinEdgeLength=0.0001, MinTolerance=0, Refine=True, RefineAngle=0, RelativeTolerance=0.65, SimplePlanes=True, Tolerance=0})
panel_2 = Panel("localhost")
panel_3 = Panel("ghxr/geometry/positions/share")
# -Don't forget to open the .3dm file !!!
# -Disconnect from any VPN if needed
#   (may block MQTT, especially if remote)
# -Be ready to validate incoming updates,
#   since GH will throw a warning.
#   (should the check "do not show again"   option)
panel_4 = Panel("mqtt.eclipse.org")
panel_5 = Panel("10.92.1.205")
panel_6 = Panel("test.mosquitto.org")
panel_7 = Panel("ghxr/geometry/meshes")
panel_8 = Panel("ghxr/parameters/share")
panel_9 = Panel("ghxr/parameters/control")
panel_10 = Panel("ghxr/geometry/positions/control")
longitudeslider = Slider(5.9415, range=-180..180)
headingslider = Slider(0, range=0..360)
latitudeslider = Slider(49.5022, range=-85..85)
localisedmesh = LocalisedMesh(Mesh=mesh, LatitudeOfTheMesh=latitudeslider, LongitudeOfTheMesh=longitudeslider, HeadingOfTheMesh=headingslider)
ghxr_simplified = GHXRSimplified(BaseMQTTTopic="ghxr", Meshes=localisedmesh, Parameters=[basescalefactor, doublescaletoggle])
