# Grasshopper definition axes.gh (Grasshopper 1.0.7)
# plug-ins: GHXRTableGH

basescalefactor = Slider(5, range=0..10)
doublescaletoggle = BooleanToggle(False)
brep = Brep(<brep referenced from the Rhino model>)
# -Don't forget to open the .3dm file !!!
# -Disconnect from any VPN if needed
#   (may block MQTT, especially if remote)
# -Be ready to validate incoming updates,
#   since GH will throw a warning.
#   (should the check "do not show again"   option)
panel = Panel("localhost")
panel_2 = Panel("10.92.1.205")
panel_3 = Panel("test.mosquitto.org")
filter = StreamFilter(Gate=doublescaletoggle, Stream0=1, Stream1=2)
scale = Scale(Geometry=brep, Center=Point(0, 0, 0), Factor=basescalefactor)  # -> Geometry, Transform
scale_2 = Scale(Geometry=scale.Geometry, Center=Point(0, 0, 0), Factor=filter)  # -> Geometry, Transform
mesh = MeshBrep(
    Brep=scale_2.Geometry,
    Settings={GridMaxCount=0, GridMinCount=16, JaggedSeams=False, MaxEdgeLength=0, MinEdgeLength=0.0001, MinTolerance=0, Refine=True, RefineAngle=0, RelativeTolerance=0.65, SimplePlanes=True, Tolerance=0})
ghxrtablegh = GHXRTableGH(
    MeshesChannel="ghxr/geometry/meshes",
    ParametersSharingChannel="ghxr/parameters/share",
    ParametersControlChannel="ghxr/parameters/control",
    GeometryPositionsSharingChannel="ghxr/geometry/positions/share",
    GeometryPositionsControlChannel="ghxr/geometry/positions/control",
    Meshes=mesh,
    GeometryPositionsData="[{\"lat\":6360517.111927,\"lon\":661403.63,\"hdg\":0}]",
    Parameters=[basescalefactor, doublescaletoggle])
