# Grasshopper definition basic-rectanglebox-v2-unconnected.gh (Grasshopper 1.0.7)
# plug-ins: GHXRTableGH

number_slider = Slider(8, range=0..10)
pt = ConstructPoint(XCoordinate=number_slider, YCoordinate=0, ZCoordinate=0)
pt_2 = ConstructPoint(XCoordinate=0, YCoordinate=Slider(4, range=0..10), ZCoordinate=0)
pt_3 = ConstructPoint(XCoordinate=0, YCoordinate=0, ZCoordinate=0)
number_slider_2 = Slider(4, range=0..10)
rec_3pt = Rectangle3Pt(PointA=pt_3, PointB=pt_2, PointC=pt)  # -> Rectangle, Length
panel = Panel("test.mosquitto.org")
boxrec = BoxRectangle(Rectangle=rec_3pt.Rectangle, Height=number_slider_2)
move = Move(Geometry=boxrec, Motion=Vector(0, 0, 10))  # -> Geometry, Transform
mesh = MeshBrep(
    Brep=move.Geometry,
    Settings={GridMaxCount=0, GridMinCount=16, JaggedSeams=False, MaxEdgeLength=0, MinEdgeLength=0.0001, MinTolerance=0, Refine=True, RefineAngle=0, RelativeTolerance=0.65, SimplePlanes=True, Tolerance=0})
mesh_2 = MeshBrep(
    Brep=boxrec,
    Settings={GridMaxCount=0, GridMinCount=16, JaggedSeams=False, MaxEdgeLength=0, MinEdgeLength=0.0001, MinTolerance=0, Refine=True, RefineAngle=0, RelativeTolerance=0.65, SimplePlanes=True, Tolerance=0})
ghxrtablegh = GHXRTableGH(
    MeshesChannel="ghxr/geometry/meshes",
    ParametersSharingChannel="ghxr/parameters/share",
    ParametersControlChannel="ghxr/parameters/control",
    GeometryPositionsSharingChannel="ghxr/geometry/positions/share",
    GeometryPositionsControlChannel="ghxr/geometry/positions/control",
    Meshes=[mesh_2, mesh],
    GeometryPositionsData="[{\"lat\":6380515.5,\"lon\":678554.25,\"hdg\":3.28}]",
    Parameters=[number_slider_2, number_slider])
