# Grasshopper definition basic-rectanglebox.gh (Grasshopper 1.0.7)
# plug-ins: GHXRTableGH

pt = ConstructPoint(XCoordinate=Slider(8, range=0..10), YCoordinate=0, ZCoordinate=0)
pt_2 = ConstructPoint(XCoordinate=0, YCoordinate=Slider(4, range=0..10), ZCoordinate=0)
pt_3 = ConstructPoint(XCoordinate=0, YCoordinate=0, ZCoordinate=0)
rec_3pt = Rectangle3Pt(PointA=pt_3, PointB=pt_2, PointC=pt)  # -> Rectangle, Length
panel = Panel("localhost")
boxrec = BoxRectangle(Rectangle=rec_3pt.Rectangle, Height=Slider(4, range=0..10))
mesh = MeshBrep(
    Brep=boxrec,
    Settings={GridMaxCount=0, GridMinCount=16, JaggedSeams=False, MaxEdgeLength=0, MinEdgeLength=0.0001, MinTolerance=0, Refine=True, RefineAngle=0, RelativeTolerance=0.65, SimplePlanes=True, Tolerance=0})
ghxrtablegh = GHXRTableGH(
    MeshesChannel="GHXRTable/Meshes",
    ParametersSharingChannel="GHXRTable/ParameterShare",
    ParametersControlChannel="GHXRTable/ParameterControl")
panel_2 = Panel(ghxrtablegh)
