# Grasshopper definition playground.gh (Grasshopper 1.0.7)

pt = ConstructPoint(XCoordinate=4, YCoordinate=4, ZCoordinate=4)
pt_2 = ConstructPoint(XCoordinate=4, YCoordinate=0, ZCoordinate=0)
pt_3 = ConstructPoint(XCoordinate=0, YCoordinate=0, ZCoordinate=0)
sph = Sphere(Base=PlaneXY(0, 0, 0), Radius=1)
number_slider = Slider(0.25, range=0..1)
msphere = MeshSphere(Base=PlaneXY(0, 0, 0), Radius=10, UCount=10, VCount=20)
pline = PolyLine(Vertices=[pt_3, pt, pt_2], Closed=Toggle(True))
join = BrepJoin()  # -> Breps, Closed
srf4pt = _4PointSurface(CornerA=pt_3, CornerB=pt, CornerC=pt_2)
cyl = Cylinder(Base=PlaneXY(0, 0, 0), Radius=0.5, Length=1)
sph_2 = Sphere(Base=PlaneXY(0, 0, 0), Radius=1)
brep = Brep()
mesh = MeshBrep(
    Brep=srf4pt,
    Settings={GridMaxCount=0, GridMinCount=16, JaggedSeams=False, MaxEdgeLength=0, MinEdgeLength=0.0001, MinTolerance=0, Refine=True, RefineAngle=0, RelativeTolerance=0.65, SimplePlanes=True, Tolerance=0})
