# Grasshopper definition test-gate-and-filter.gh (Grasshopper 1.0.7)

# ----
# Filter: ok, already handled without doing anything
number_slider = Slider(5, range=0..10)
# Gate : input ok but what about the output mesh?
# Seems like it is ok too (sending only one mesh even though the "disabled one" is also connected)
number_slider_2 = Slider(5, range=0..10)
pt = ConstructPoint(XCoordinate=0, YCoordinate=0, ZCoordinate=0)
pt_2 = ConstructPoint(XCoordinate=number_slider, YCoordinate=number_slider, ZCoordinate=number_slider)
sph = Sphere(Base=PlaneXY(0, 0, 0), Radius=number_slider_2)
box = Box2Pt(PointA=pt, PointB=pt_2, Plane=PlaneXY(0, 0, 0))
list = ValueList({"True": true, "False": false}, selected="True")
filter = StreamFilter(Gate=Toggle(False), Stream0=box, Stream1=sph)
mesh = MeshBrep(
    Brep=filter,
    Settings={GridMaxCount=0, GridMinCount=16, JaggedSeams=False, MaxEdgeLength=0, MinEdgeLength=0.0001, MinTolerance=0, Refine=True, RefineAngle=0, RelativeTolerance=0.65, SimplePlanes=True, Tolerance=0})

list_2 = ValueList({"Zero": 0, "One": 1}, selected="Zero")
gate = StreamGate(Stream=Slider(5, range=0..10), Gate=Toggle(False))  # -> Target0, Target1
pt_3 = ConstructPoint(XCoordinate=0, YCoordinate=0, ZCoordinate=0)
sph_2 = Sphere(Base=PlaneXY(0, 0, 0), Radius=gate.Target0)
pt_4 = ConstructPoint(XCoordinate=gate.Target1, YCoordinate=gate.Target1, ZCoordinate=gate.Target1)
box_2 = Box2Pt(PointA=pt_3, PointB=pt_4, Plane=PlaneXY(0, 0, 0))
mesh_2 = MeshBrep(
    Brep=[sph_2, box_2],
    Settings={GridMaxCount=0, GridMinCount=16, JaggedSeams=False, MaxEdgeLength=0, MinEdgeLength=0.0001, MinTolerance=0, Refine=True, RefineAngle=0, RelativeTolerance=0.65, SimplePlanes=True, Tolerance=0})

panel = Panel(mesh_2)
