# Grasshopper definition test-input-options.gh (Grasshopper 1.0.7)
# plug-ins: GHXRTableGH

# Fancy stuff, likely not useful, except maybe a color picker? Can we easily add support for that?
md_slider = MDSlider(SliderMode=0, slider_value=Point(0.5, 0.5, 0.5), x_domain=Domain(0, 1), y_domain=Domain(0, 1), z_domain=Domain(0, 1))
wheel = ColourWheel(
    ColourGrips_Style=31,
    ColourGrips_Grip=[0, 2.094395102, 4.188790205, 3.141592654],
    ColourGrips_Lum=[0.1, 0.5],
    ColourGrips_Range=[0.2617993878, 0.2617993878, 0.2617993878, 0.2617993878],
    ColourGrips_Sat=[0.2, 0.6])
# Potentially useful but
# can/should we actually support them?
knob = ControlKnob(Decimals=2, Limit=True, Maximum=10, Minimum=0, Range=1, Value=0.9)
digit_scroller = DigitScroller(Scroller_Digits=12, Scroller_Radix=1, Scroller_Value=-1.25e-08)
calendar = Calendar()
button = Button()
gradient = Gradient(LowerLimit=0, UpperLimit=1, stops=[0.15: RGB(255, 130, 160), 0.85: RGB(220, 0, 40)])
swatch = ColourSwatch(SwatchColor=RGB(255, 255, 255))
graph = GraphMapper()
clock = Clock(SecondHand=True)
list_check = ValueList({"One-checked": one checked, "Two": two unchecked}, selected="One-checked")
list_cycle = ValueList({"One": 1, "Two": 2, "Three": 2² - 1, "Four": Sqrt(16), "a": ""}, selected="Three")
# Important
list_drop = ValueList({"One": 1, "Two": 2, "Three": 2² - 1, "Four": Sqrt(16), "a": ""}, selected="Three")
list_seq = ValueList({"One": 1, "Two": 2, "Three": 2² - 1, "Four": Sqrt(16), "a": ""}, selected="Three")
colour = ColourPicker(PickedColour=RGB(255, 105, 180))
panel = Panel("localhost")
toggle = BooleanToggle(False)
number_slider = Slider(0.25, range=0..1)
ghxrtablegh = GHXRTableGH(
    MeshesChannel="ghxra",
    ParametersSharingChannel="ghxrb",
    ParametersControlChannel="ghxrc",
    GeometryPositionsSharingChannel="ghxrd",
    GeometryPositionsControlChannel="ghxre",
    Parameters=[list_drop, list_check, list_seq, list_cycle, knob])
panel_2 = Panel(ghxrtablegh)
